# Grasshopper definition test_model.gh (Grasshopper 0.9.80)

origin = Point(Point(0, 0, 0))
pt = Point(Point(45, 45, 5))
list = ValueList({"10 μm": 0.010, "20 μm": 0.020, "30 μm": 0.030, "40 μm": 0.040, "50 μm": 0.050, "60 μm": 0.060, "70 μm": 0.070, "80 μm": 0.080, "90 μm": 0.090, "100 μm": 0.100, "200 μm": 0.200, "300 μm": 0.300, "400 μm": 0.400, "500 μm": 0.500, "600 μm": 0.600, "700 μm": 0.700, "800 μm": 0.800, "900 μm": 0.900, "1000 μm": 1.000}, selected="10 μm")
box = Box2Pt(PointA=origin, PointB=pt, Plane=PlaneXY(0, 0, 0))
